# Grasshopper definition WikiHouseUFRJ_v22.gh (Grasshopper 0.9.76)
# Copyright: Copyleft!

surface = Surface([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])
sjoints = Point([Point(1650, 0, 1358.406785), Point(-547.8652142, 0, 2533.633198), Point(-1847.251403, 0, 1719.01949), Point(1271.999083, 0, -1650), Point(2048.93949, 0, -478.4767093), Point(-1234.843498, 0, -1650), Point(-2149.962952, 0, -480.1666822)])

# ---- group: Medidas chapa de compensado estrutural
comprimento = Slider(2200, range=0..2500)
espessura = Slider(18.7, range=10..40)
largura = Slider(1600, range=0..2500)

# ----
comprimento_dos_pegs = Slider(40, range=0..40)

# ---- group: Medidas chapa de compensado de fechamento
comprimento_2 = Slider(2500, range=0..2500)
espessura_2 = Slider(6, range=3..30)
largura_2 = Slider(1600, range=0..2500)

# ----
modulos = ValueList({"One": 1, "Two": 2, "Three": 3, "Four": 4, "Five": 5, "Six": 6, "Seven": 7, "Eight": 8, "Nine": 9, "Ten": 10}, selected="One")

# ---- group: Tamanho da edificacao
modulo_em_milimetros = Panel("1200")
multiplication = Multiplication(A=modulo_em_milimetros, B=modulos)
subtraction = Subtraction(A=multiplication, B=300)
comprimento_total_em_milimetros = Panel(subtraction)

# ----
largura_do_frame = Slider(200, range=50..400)
conectores_horizontais = Point([Point(-1500, 0, -1650), Point(1500, 0, -1650), Point(-1000, 0, -1650), Point(-500, 0, -1650), Point(1000, 0, -1650), Point(500, 0, -1650), Point(0, 0, -1650), Point(1925.701956, 0, 513.8629084), Point(783.3775218, 0, 2267.892038), Point(1903.401679, 0, -1246.399591), Point(-1954.012181, 0, -1204.587546), Point(-2077.144381, 0, 503.6249281), Point(-527.4956377, 0, 1238.009999)])
# INPUTS
frame = Curve(<curve referenced from the Rhino model>)
surface_curve = SurfaceCurve(Surface=surface, Curve=frame)  # -> Curves, flatten(Points), UVPoints, Normals, Parameters, Tangents

# ---- group: Split panels
subtraction_2 = Subtraction(A=comprimento_2, B=Slider(100, range=0..200))
divide_length = DivideLength(Curve=frame, Length=subtraction_2)  # -> flatten(Points), Tangents, Parameters

# ----
pegs = Point([Point(-2086.079103, 0, -834.2948755), Point(-2154.961187, 0, -430.040944), Point(-2154.783708, 0, 74.94237982), Point(-2103.298879, 0, 402.3201929), Point(-1997.318541, 0, 719.0898731), Point(-1491.776833, 0, 1044.279118)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])
curve_closest_point = CurveClosestPoint(Point=sjoints, Curve=frame)  # -> Point, Parameter, Distance
evaluate_curve = EvaluateCurve(Curve=frame, Parameter=curve_closest_point.Parameter)  # -> Point, Tangent, Angle
# ANALISE DA CURVA
number_slider = Slider(133, range=100..200)
construct_point = ConstructPoint(XCoordinate=comprimento_2, YCoordinate=largura_2, ZCoordinate="0")
construct_point_2 = ConstructPoint(XCoordinate="0", YCoordinate="0", ZCoordinate="0")
construct_point_3 = ConstructPoint(XCoordinate=comprimento, YCoordinate=largura, ZCoordinate="0")
construct_point_4 = ConstructPoint(XCoordinate="0", YCoordinate="0", ZCoordinate="0")
curvature_graph = CurvatureGraph(Curve=frame, Density=50, Scale=number_slider)
rectangle_2pt = Rectangle2Pt(Plane=PlaneXY(0, 0, 0), PointA=construct_point, PointB=construct_point_2, Radius=0)  # -> Rectangle, Length
rectangle_2pt_2 = Rectangle2Pt(Plane=PlaneXY(0, 0, 0), PointA=construct_point_3, PointB=construct_point_4, Radius=0)  # -> Rectangle, Length
offset_margem_seguranca = Offset(Curve=rectangle_2pt_2.Rectangle, Distance="-20", Plane=PlaneXY(0, 0, 0), Corners=1)
offset_margem_seguranca_2 = Offset(Curve=rectangle_2pt.Rectangle, Distance="-20", Plane=PlaneXY(0, 0, 0), Corners=1)
# ANALISE DA FORMA
rail = Curve(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)
point = Point(Point(-1750, 0, -1750))
multiplication_2 = Multiplication(A=modulos, B="1.2")
scale = Scale(Geometry=rail, Center=point, Factor=multiplication_2)  # -> Geometry, Transform
unit_y = UnitY(Factor="900")
# FRAMES
division = Division(A=largura_do_frame, B="2")
unit_y_2 = UnitY(Factor="1200")
multiplication_3 = Multiplication(A=division, B="-1")
offset = Offset(Curve=frame, Distance=division, Plane=PlaneXY(0, 0, 0), Corners=1)
length = Length(Curve=offset)
extrude_along = ExtrudeAlong(Base=offset, Curve=scale.Geometry)
panel = Panel(length)
offset_2 = Offset(Curve=frame, Distance=multiplication_3, Plane=PlaneXY(0, 0, 0), Corners=1)

# ----
# 2D FRAMES + PEGS PANELS
pegs_2 = Point(pegs)
offset_frame_interno = Curve(offset_2)
offset_frame_externo = Curve(offset)
addition = Addition(A=espessura_2, B=0.25)
negative = Negative(Value=addition)
addition_2 = Addition(A=espessura_2, B=0.25)
curve_closest_point_2 = CurveClosestPoint(Point=pegs_2, Curve=offset_frame_externo)  # -> Point, Parameter, Distance
offset_3 = Offset(Curve=offset_frame_externo, Distance=negative, Plane=Plane(origin=(0, 0, 0), x=(0, 0, 1), y=(1, 0, 0)), Corners=1)
negative_2 = Negative(Value=addition_2)
curve_closest_point_3 = CurveClosestPoint(Point=pegs_2, Curve=offset_frame_interno)  # -> Point, Parameter, Distance
unit_y_3 = UnitY(Factor=1)
offset_4 = Offset(Curve=offset_frame_interno, Distance=addition_2, Plane=Plane(origin=(0, 0, 0), x=(0, 0, 1), y=(1, 0, 0)), Corners=1)
circle_cnr = CircleCNR(Center=curve_closest_point_2.Point, Normal=unit_y_3, Radius=comprimento_dos_pegs)  # -> flatten(Circle)
unit_y_4 = UnitY(Factor=1)
trim_with_regions = TrimWithRegions(Curve=offset_3, Regions=circle_cnr)  # -> Inside, Outside
circle_cnr_2 = CircleCNR(Center=curve_closest_point_3.Point, Normal=unit_y_4, Radius=comprimento_dos_pegs)  # -> flatten(Circle)
trim_with_regions_2 = TrimWithRegions(Curve=offset_4, Regions=circle_cnr_2)  # -> Inside, Outside
trim_with_regions_3 = TrimWithRegions(Curve=offset_frame_externo, Regions=circle_cnr)  # -> Inside, Outside
trim_with_regions_4 = TrimWithRegions(Curve=offset_frame_interno, Regions=circle_cnr_2)  # -> Inside, Outside
curve = Curve(trim_with_regions_3.Outside)
curve_2 = Curve(trim_with_regions.Inside)
number_slider_2 = Slider(26, range=0..27)
end_points = EndPoints(Curve=reparameterize(curve))  # -> Start, End
end_points_2 = EndPoints(Curve=reparameterize(curve_2))  # -> Start, End
curve_3 = Curve(trim_with_regions_4.Outside)
curve_4 = Curve(trim_with_regions_2.Inside)
number_slider_3 = Slider(26, range=0..27)
end_points_3 = EndPoints(Curve=reparameterize(curve_3))  # -> Start, End
end_points_4 = EndPoints(Curve=reparameterize(curve_4))  # -> Start, End
list_item = ListItem(List=end_points_2.End, Index=number_slider_2, Wrap=True)
list_item_2 = ListItem(List=end_points.Start, Index=0, Wrap=True)
shift_list = ShiftList(List=end_points_2.End, Shift=number_slider_2, Wrap=True)
list_item_3 = ListItem(List=end_points_4.End, Index=number_slider_3, Wrap=True)
list_item_4 = ListItem(List=end_points_3.Start, Index=0, Wrap=True)
line = Line(StartPoint=end_points.End, EndPoint=end_points_2.Start)
line_2 = Line(StartPoint=end_points.Start, EndPoint=shift_list)
shift_list_2 = ShiftList(List=end_points_4.End, Shift=number_slider_3, Wrap=True)
line_3 = Line(StartPoint=end_points_3.End, EndPoint=end_points_4.Start)
line_4 = Line(StartPoint=end_points_3.Start, EndPoint=shift_list_2)
join_curves = JoinCurves(Curves=flatten([line_4, line_3, curve_3, curve_4]), Preserve=False)
join_curves_2 = JoinCurves(Curves=flatten([line_2, line, curve, curve_2]), Preserve=False)

ruled_surface = RuledSurface(CurveA=offset, CurveB=offset_2)
offset_frame_interno_2 = Curve(offset_2)
offset_frame_externo_2 = Curve(offset)
offset_frame_interno_3 = Curve(offset_2)
offset_frame_externo_3 = Curve(offset)
curve_closest_point_4 = CurveClosestPoint(Point=sjoints, Curve=graft([offset_frame_interno_2, offset_frame_externo_2]))  # -> flatten(Point), Parameter, Distance
curve_closest_point_5 = CurveClosestPoint(Point=sjoints, Curve=graft([offset_frame_interno_3, offset_frame_externo_3]))  # -> flatten(Point), Parameter, Distance
list_length = ListLength(List=curve_closest_point_5.Point)
integer_division = IntegerDivision(A=list_length, B=2)
split_list = SplitList(List=curve_closest_point_4.Point, Index=integer_division)  # -> ListA, ListB
split_list_2 = SplitList(List=curve_closest_point_5.Point, Index=integer_division)  # -> ListA, ListB
line_5 = Line(StartPoint=split_list.ListA, EndPoint=split_list.ListB)
panel_2 = Panel("""100
-100""")
line_6 = Line(StartPoint=split_list_2.ListA, EndPoint=split_list_2.ListB)
panel_3 = Panel("""100
-100""")
offset_5 = Offset(Curve=line_5, Distance=graft(panel_2), Plane=Plane(origin=(0, 0, 0), x=(0, 0, 1), y=(1, 0, 0)), Corners=1)
panel_4 = Panel(espessura)
offset_6 = Offset(Curve=line_6, Distance=graft(panel_3), Plane=Plane(origin=(0, 0, 0), x=(0, 0, 1), y=(1, 0, 0)), Corners=1)
offset_frame_externo_4 = Curve(offset)
offset_frame_interno_4 = Curve(offset_2)
construct_point_5 = ConstructPoint(XCoordinate=Slider(103, range=0..103), YCoordinate="0", ZCoordinate=panel_4)
construct_point_6 = ConstructPoint(XCoordinate="0", YCoordinate="0", ZCoordinate="0")
extend_curve = ExtendCurve(Curve=offset_5, Type=0, Start=40, End=40)  # -> flatten(Curve)
offset_7 = Offset(Curve=offset_frame_externo_4, Distance=66, Plane=Plane(origin=(0, 0, 0), x=(0, 0, 1), y=(1, 0, 0)), Corners=1)
offset_8 = Offset(Curve=offset_frame_interno_4, Distance=-66, Plane=Plane(origin=(0, 0, 0), x=(0, 0, 1), y=(1, 0, 0)), Corners=1)
extend_curve_2 = ExtendCurve(Curve=offset_6, Type=0, Start=40, End=40)  # -> flatten(Curve)
rectangle_2pt_3 = Rectangle2Pt(Plane=Plane(origin=(0, 0, 0), x=(0, 0, 1), y=(1, 0, 0)), PointA=construct_point_5, PointB=construct_point_6, Radius=0)  # -> Rectangle, Length
split_list_3 = SplitList(List=extend_curve, Index=integer_division)  # -> ListA, ListB
split_list_4 = SplitList(List=extend_curve_2, Index=integer_division)  # -> ListA, ListB
unit_y_5 = UnitY(Factor=1)
area = Area(Geometry=rectangle_2pt_3.Rectangle)  # -> Area, Centroid
unit_y_6 = UnitY(Factor=1)
curve_curve = CurveCurve(CurveA=split_list_3.ListA, CurveB=flatten(offset_frame_externo_2))  # -> Points, ParamsA, ParamsB
curve_curve_2 = CurveCurve(CurveA=split_list_3.ListB, CurveB=flatten(offset_frame_interno_2))  # -> Points, ParamsA, ParamsB
unit_y_7 = UnitY(Factor=1)
curve_curve_3 = CurveCurve(CurveA=split_list_4.ListA, CurveB=flatten(offset_frame_interno_3))  # -> Points, ParamsA, ParamsB
curve_curve_4 = CurveCurve(CurveA=split_list_4.ListB, CurveB=flatten(offset_frame_externo_3))  # -> Points, ParamsA, ParamsB
rotate_3d = Rotate3D(Geometry=split_list_3.ListA, Angle=degrees(15), Center=flatten(curve_curve.Points), Axis=unit_y_5)  # -> Geometry, Transform
unit_y_8 = UnitY(Factor=1)
rotate_3d_2 = Rotate3D(Geometry=split_list_4.ListA, Angle=degrees(-15), Center=flatten(curve_curve_3.Points), Axis=unit_y_6)  # -> Geometry, Transform
rotate_3d_3 = Rotate3D(Geometry=split_list_3.ListB, Angle=degrees(15), Center=flatten(curve_curve_2.Points), Axis=unit_y_7)  # -> Geometry, Transform
offset_66_interno = Curve(offset_8)
offset_66_interno_2 = Curve(offset_7)
# S JOINTS 2
offset_66_interno_3 = Curve(offset_7)
rotate_3d_4 = Rotate3D(Geometry=split_list_4.ListB, Angle=degrees(-15), Center=flatten(curve_curve_4.Points), Axis=unit_y_8)  # -> Geometry, Transform
# S JOINTS 1
offset_66_interno_4 = Curve(offset_8)
curve_curve_5 = CurveCurve(CurveA=line_5, CurveB=offset_66_interno)  # -> Points, ParamsA, ParamsB
curve_curve_6 = CurveCurve(CurveA=line_6, CurveB=offset_66_interno_2)  # -> Points, ParamsA, ParamsB
curve_curve_7 = CurveCurve(CurveA=rotate_3d_3.Geometry, CurveB=offset_66_interno_3)  # -> Points, ParamsA, ParamsB
curve_curve_8 = CurveCurve(CurveA=rotate_3d.Geometry, CurveB=offset_66_interno)  # -> Points, ParamsA, ParamsB
curve_curve_9 = CurveCurve(CurveA=line_5, CurveB=offset_66_interno_3)  # -> Points, ParamsA, ParamsB
curve_5 = Curve(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)
curve_curve_10 = CurveCurve(CurveA=rotate_3d_4.Geometry, CurveB=offset_66_interno_4)  # -> Points, ParamsA, ParamsB
curve_curve_11 = CurveCurve(CurveA=rotate_3d_2.Geometry, CurveB=offset_66_interno_2)  # -> Points, ParamsA, ParamsB
curve_curve_12 = CurveCurve(CurveA=line_6, CurveB=offset_66_interno_4)  # -> Points, ParamsA, ParamsB
line_7 = Line(StartPoint=curve_curve_9.Points, EndPoint=curve_curve_5.Points)
end_points_5 = EndPoints(Curve=line_7)  # -> Start, End
scale_2 = Scale(Geometry=line_7, Center=end_points_5.End, Factor=0.5)  # -> Geometry, Transform
orient = Orient(Geometry=rectangle_2pt_3.Rectangle, Source=area.Centroid, Target=scale_2.Geometry)  # -> Geometry, Transform
line_8 = Line(StartPoint=curve_curve_9.Points, EndPoint=curve_curve_7.Points)
line_9 = Line(StartPoint=curve_curve_2.Points, EndPoint=curve_curve_7.Points)
line_10 = Line(StartPoint=curve_curve_5.Points, EndPoint=curve_curve_8.Points)
line_11 = Line(StartPoint=curve_curve.Points, EndPoint=curve_curve_8.Points)
line_12 = Line(StartPoint=curve_curve_12.Points, EndPoint=curve_curve_10.Points)
line_13 = Line(StartPoint=curve_curve_4.Points, EndPoint=curve_curve_10.Points)
line_14 = Line(StartPoint=curve_curve_12.Points, EndPoint=curve_curve_6.Points)
line_15 = Line(StartPoint=curve_curve_6.Points, EndPoint=curve_curve_11.Points)
line_16 = Line(StartPoint=curve_curve_3.Points, EndPoint=curve_curve_11.Points)
trim_with_region = TrimWithRegion(Curve=line_7, Region=orient.Geometry)  # -> Inside, Outside
curve_6 = Curve(trim_with_region.Outside)
join_curves_3 = JoinCurves(Curves=[line_8, line_9, line_11, line_10, curve_6], Preserve=False)
join_curves_4 = JoinCurves(Curves=[line_12, line_13, line_14, line_16, line_15], Preserve=False)
curve_closest_point_6 = CurveClosestPoint(Point=conectores_horizontais, Curve=graft([offset_2, offset]))  # -> flatten(Point), Parameter, Distance
# CONECTORES PRIMARIOS 1
list_length_2 = ListLength(List=curve_closest_point_6.Point)
integer_division_2 = IntegerDivision(A=list_length_2, B=2)
split_list_5 = SplitList(List=flatten(curve_closest_point_6.Point), Index=integer_division_2)  # -> ListA, ListB
line_17 = Line(StartPoint=split_list_5.ListA, EndPoint=split_list_5.ListB)
offset_9 = Offset(Curve=line_17, Distance=espessura, Plane=Plane(origin=(0, 0, 0), x=(0, 0, 1), y=(1, 0, 0)), Corners=1)
addition_3 = Addition(A=espessura, B="900.25")
addition_4 = Addition(A=espessura, B=0.25)
addition_5 = Addition(A="-68", B="900")
end_points_6 = EndPoints(Curve=offset_9)  # -> flatten(Start), flatten(End)
end_points_7 = EndPoints(Curve=line_17)  # -> flatten(Start), flatten(End)
line_18 = Line(StartPoint=end_points_7.End, EndPoint=end_points_6.End)
line_19 = Line(StartPoint=end_points_7.Start, EndPoint=end_points_6.Start)
offset_10 = Offset(Curve=line_18, Distance="60", Plane=Plane(origin=(0, 0, 0), x=(0, 0, 1), y=(1, 0, 0)), Corners=1)
offset_11 = Offset(Curve=line_19, Distance="-60", Plane=Plane(origin=(0, 0, 0), x=(0, 0, 1), y=(1, 0, 0)), Corners=1)
end_points_8 = EndPoints(Curve=offset_10)  # -> flatten(Start), flatten(End)
end_points_9 = EndPoints(Curve=offset_11)  # -> flatten(Start), flatten(End)
_4point_surface = _4PointSurface(CornerA=end_points_9.Start, CornerB=end_points_9.End, CornerC=end_points_8.End, CornerD=end_points_8.Start)
unit_y_9 = UnitY(Factor=addition_3)
unit_y_10 = UnitY(Factor="-68")
unit_y_11 = UnitY(Factor=addition_5)
unit_y_12 = UnitY(Factor=addition_4)
deconstruct_brep = DeconstructBrep(Brep=_4point_surface)  # -> Faces, Edges, Vertices
_4point_surface_2 = _4PointSurface(CornerA=end_points_7.Start, CornerB=end_points_7.End, CornerC=end_points_6.End, CornerD=end_points_6.Start)
area_2 = Area(Geometry=_4point_surface_2)  # -> Area, Centroid

move = Move(Geometry=_4point_surface, Motion=unit_y_11)  # -> Geometry, Transform
move_2 = Move(Geometry=_4point_surface, Motion=unit_y_10)  # -> Geometry, Transform

move_3 = Move(Geometry=_4point_surface_2, Motion=unit_y_12)  # -> Geometry, Transform
move_4 = Move(Geometry=_4point_surface_2, Motion=unit_y_9)  # -> Geometry, Transform

join_curves_5 = JoinCurves(Curves=deconstruct_brep.Edges, Preserve=False)
boundary_surfaces = BoundarySurfaces(Edges=flatten([orient.Geometry, join_curves_5, join_curves, join_curves_2]))

boundary_surfaces_2 = BoundarySurfaces(Edges=offset)
extrude_along_2 = ExtrudeAlong(Base=boundary_surfaces, Curve=scale.Geometry)

move_5 = Move(Geometry=boundary_surfaces, Motion=unit_y)  # -> Geometry, Transform
area_3 = Area(Geometry=boundary_surfaces)  # -> Area, Centroid
multiplication_4 = Multiplication(A=espessura, B="2")
subtraction_3 = Subtraction(A="899.5", B=multiplication_4)
# CONECTORES PRIMARIOS
division_2 = Division(A=subtraction_3, B=2)
multiplication_5 = Multiplication(A=espessura, B="2")
subtraction_4 = Subtraction(A="299.5", B=multiplication_5)
division_3 = Division(A=subtraction_4, B=2)
sjoints_v2 = Curve(flatten(join_curves_3))
sjoints_v1 = Curve(flatten(join_curves_4))
unit_y_13 = UnitY(Factor="110")
unit_y_14 = UnitY(Factor=division_2)
unit_y_15 = UnitY(Factor="110")
unit_y_16 = UnitY(Factor=division_3)
negative_3 = Negative(Value=espessura)
unit_y_17 = UnitY(Factor="1200")
unit_y_18 = UnitY(Factor="1200")
unit_y_19 = UnitY(Factor=negative_3)

# ----
# EXTRUDE TO 3D
extrude = Extrude(Base=move_3.Geometry, Direction=unit_y_14)
extrude_2 = Extrude(Base=move_2.Geometry, Direction=unit_y_13)
conectores_primarios_extrudados = Geometry(extrude)

unit_y_20 = UnitY(Factor=espessura)
extrude_3 = Extrude(Base=move.Geometry, Direction=unit_y_15)
solid_union = SolidUnion(Breps=[extrude_2, conectores_primarios_extrudados])
extrude_4 = Extrude(Base=move_4.Geometry, Direction=unit_y_16)
solid_union_2 = SolidUnion(Breps=[extrude_4, extrude_3])
box_corners = BoxCorners(Box=solid_union)  # -> CornerA, CornerB, CornerC, CornerD, CornerE, CornerF, CornerG, CornerH
box_corners_2 = BoxCorners(Box=solid_union_2)  # -> CornerA, CornerB, CornerC, CornerD, CornerE, CornerF, CornerG, CornerH
conectores_primarios_extrudados_2 = Geometry(extrude_4)
point_2 = Point(box_corners.CornerC)
point_3 = Point(box_corners.CornerD)
point_4 = Point(box_corners_2.CornerC)
point_5 = Point(box_corners.CornerG)
point_6 = Point(box_corners.CornerF)
point_7 = Point(box_corners_2.CornerD)
point_8 = Point(box_corners_2.CornerG)
subtraction_5 = Subtraction(A=modulos, B=1)
plane_3pt = Plane3Pt(PointA=point_2, PointB=point_3, PointC=point_5)
plane_3pt_2 = Plane3Pt(PointA=point_4, PointB=point_7, PointC=point_8)
mirror = Mirror(Geometry=solid_union_2, Plane=plane_3pt_2)  # -> Geometry, Transform
solid_union_3 = SolidUnion(Breps=[mirror.Geometry, solid_union_2])  # -> flatten(Result)
conector_primario_menor_extrudado = Geometry(solid_union_3)
move_away_from = MoveAwayFrom(Geometry=conector_primario_menor_extrudado, Emitter=conector_primario_menor_extrudado, Distance=espessura)  # -> flatten(Geometry), Transform
mirror_2 = Mirror(Geometry=solid_union, Plane=plane_3pt)  # -> Geometry, Transform
solid_union_4 = SolidUnion(Breps=[mirror_2.Geometry, solid_union])  # -> flatten(Result)
conector_primario_maior_extrudado = Geometry(solid_union_4)
linear_array = LinearArray(Geometry=conector_primario_maior_extrudado, Direction=unit_y_17, Count=modulos)  # -> flatten(Geometry), Transform
linear_array_2 = LinearArray(Geometry=move_away_from.Geometry, Direction=unit_y_18, Count=subtraction_5)  # -> flatten(Geometry), Transform
brep_join = BrepJoin(Breps=[linear_array.Geometry, linear_array_2.Geometry])  # -> Breps, Closed
offset_frame_interno_5 = Curve(offset_2)
negative_4 = Negative(Value="0.25")
negative_5 = Negative(Value=espessura_2)
offset_12 = Offset(Curve=offset_frame_interno_5, Distance=negative_4, Plane=PlaneXY(0, 0, 0), Corners=1)
offset_frame_externo_5 = Curve(offset)

# ----
# GAP 4mm DIVISOR PAINEIS
offset_frame_interno_6 = Curve(offset_2)
offset_frame_externo_6 = Curve(offset)
curve_closest_point_7 = CurveClosestPoint(Point=divide_length.Points, Curve=graft([offset_frame_externo_6, offset_frame_interno_6]))  # -> flatten(Point), Parameter, Distance
list_length_3 = ListLength(List=curve_closest_point_7.Point)
integer_division_3 = IntegerDivision(A=list_length_3, B=2)
split_list_6 = SplitList(List=curve_closest_point_7.Point, Index=integer_division_3)  # -> ListA, ListB
line_20 = Line(StartPoint=split_list_6.ListA, EndPoint=split_list_6.ListB)
offset_13 = Offset(Curve=line_20, Distance="-2", Plane=Plane(origin=(0, 0, 0), x=(0, 0, 1), y=(1, 0, 0)), Corners=1)
multiplication_6 = Multiplication(A=espessura_2, B=2)
offset_14 = Offset(Curve=line_20, Distance="2", Plane=Plane(origin=(0, 0, 0), x=(0, 0, 1), y=(1, 0, 0)), Corners=1)
extend_curve_3 = ExtendCurve(Curve=offset_14, Type=0, Start=multiplication_6, End=multiplication_6)
extend_curve_4 = ExtendCurve(Curve=offset_13, Type=0, Start=multiplication_6, End=multiplication_6)
ruled_surface_2 = RuledSurface(CurveA=extend_curve_3, CurveB=extend_curve_4)

division_4 = Division(A="-300", B=2)
offset_15 = Offset(Curve=offset_12, Distance=negative_5, Plane=PlaneXY(0, 0, 0), Corners=1)
addition_6 = Addition(A=espessura_2, B="0.25")
unit_y_21 = UnitY(Factor=division_4)
# 3D PANELS INTERIOR
ruled_surface_3 = RuledSurface(CurveA=offset_12, CurveB=offset_15)
# 3D PANELS EXTERIOR
offset_16 = Offset(Curve=offset_frame_externo_5, Distance="0.25", Plane=PlaneXY(0, 0, 0), Corners=1)
division_5 = Division(A="-300", B=2)
offset_17 = Offset(Curve=offset_frame_externo_5, Distance=addition_6, Plane=PlaneXY(0, 0, 0), Corners=1)
move_6 = Move(Geometry=ruled_surface_3, Motion=unit_y_21)  # -> Geometry, Transform
move_7 = Move(Geometry=ruled_surface_2, Motion=unit_y_21)  # -> Geometry, Transform
unit_y_22 = UnitY(Factor=division_5)
ruled_surface_4 = RuledSurface(CurveA=offset_16, CurveB=offset_17)
unit_y_23 = UnitY(Factor=modulo_em_milimetros)
move_8 = Move(Geometry=ruled_surface_4, Motion=unit_y_22)  # -> Geometry, Transform
move_9 = Move(Geometry=ruled_surface_2, Motion=unit_y_22)  # -> Geometry, Transform
extrude_5 = Extrude(Base=move_6.Geometry, Direction=unit_y_23)
unit_y_24 = UnitY(Factor=modulo_em_milimetros)
extrude_6 = Extrude(Base=move_7.Geometry, Direction=unit_y_23)
extrude_7 = Extrude(Base=move_8.Geometry, Direction=unit_y_24)
solid_difference = SolidDifference(BrepsA=extrude_5, BrepsB=flatten(extrude_6))
linear_array_3 = LinearArray(Geometry=solid_difference, Direction=unit_y_2, Count=modulos)  # -> Geometry, Transform
extrude_8 = Extrude(Base=move_9.Geometry, Direction=unit_y_24)
solid_difference_2 = SolidDifference(BrepsA=extrude_7, BrepsB=flatten(extrude_8))
linear_array_4 = LinearArray(Geometry=solid_difference_2, Direction=unit_y_2, Count=modulos)  # -> Geometry, Transform

linear_array_5 = LinearArray(Geometry=[move_5.Geometry, boundary_surfaces], Direction=unit_y_2, Count=modulos)  # -> Geometry, Transform

list_item_5 = ListItem(List=linear_array_5.Geometry, Index=0, Wrap=True)  # -> Item1, Item
surface_2 = Surface(list_item_5.Item1)
surface_3 = Surface(list_item_5.Item)
list_item_6 = ListItem(List=flatten(surface_3), Index=0, Wrap=True)  # -> Item1, Item
list_item_7 = ListItem(List=flatten(surface_2), Index=0, Wrap=True)  # -> Item1, Item

primeiro_frame = Surface(list_item_6.Item1)
ultimo_frame = Surface(list_item_7.Item)

frames_array = Geometry(linear_array_5.Geometry)
frames_array_2 = Geometry(linear_array_5.Geometry)
# EXTRUDE TO 3D
# FRAMES
surface_split = SurfaceSplit(Surface=frames_array_2, Curves=sjoints_v1)
surface_split_2 = SurfaceSplit(Surface=frames_array, Curves=sjoints_v2)
extrude_9 = Extrude(Base=surface_split, Direction=unit_y_20)
extrude_10 = Extrude(Base=surface_split_2, Direction=unit_y_19)
geometry = Geometry([extrude_10, extrude_9])
solid_difference_3 = SolidDifference(BrepsA=flatten(geometry), BrepsB=brep_join.Breps)
solid_difference_4 = SolidDifference(BrepsA=linear_array_3.Geometry, BrepsB=flatten(geometry))
solid_difference_5 = SolidDifference(BrepsA=linear_array_4.Geometry, BrepsB=flatten(geometry))
